# Grasshopper definition Curve method.ghx (Grasshopper 1.0.7)
# plug-ins: treesloth01, Human, Bifocals

panel = Panel("""Curve
Curve
Curve
Curve""")
dpipeline = DynamicGeometryPipeline(
    LayerFilter="Layer 01::Input Curves",
    TypeFilter="Curve",
    NameFilter="*",
    GroupByLayer=False,
    GroupByType=False,
    IncludeHidden=True,
    IncludeLocked=True,
    enableFullPath=True,
    listenToAttributes=True)
panel_2 = Panel("""Y
Y
X
X""")

# ---- group: Cluster
tower_by_curves = TowerByCurves(geo=dpipeline)  # -> roof_2, roof_properties_2, full_mass_2, full_mass_properties_2, sub_mass_2, sub_mass_properties_2, facade_3, facade_properties_2, floorplates_2, floorplate_properties_2

# ----
panel_3 = Panel("""Resi
Comm
Resi
Resi""")
panel_4 = Panel("""3
3
3
3""")
panel_5 = Panel("""3
15
23
19""")
panel_6 = Panel("""A
A
A
A""")
output = DataOutput(
    Roof=tower_by_curves.roof_2,
    Roof_Properties=tower_by_curves.roof_properties_2,
    Full_Mass=tower_by_curves.full_mass_2,
    Full_Mass_Properties=tower_by_curves.full_mass_properties_2,
    Sub_Mass=tower_by_curves.sub_mass_2,
    Sub_Mass_Properties=tower_by_curves.sub_mass_properties_2,
    Facade=tower_by_curves.facade_3,
    Facade_Properties=tower_by_curves.facade_properties_2,
    Floorplates=tower_by_curves.floorplates_2,
    Floorplate_Properties=tower_by_curves.floorplate_properties_2,
    Destination="C:\Users\c-nbungbrakearti\Documents\GitHub\Hackathon2018\Compiled Feaso Components\Massing Methods\Curve Method\Curve Method.ghdata")
entwine = Entwine(Branch00=panel_2, Branch01=panel_3, Branch02=panel_4, Branch03=panel_5, Branch04=panel_6, FlattenInputs=True)  # -> simplify(Result)

keysearch = KeyValueSearch(Search="BuildID")
keysearch_2 = KeyValueSearch(Search="SubBuildID")
bucketsimitems = BucketSimItems(flatlist=flatten(keysearch), synchronous=flatten(keysearch_2))  # -> buckets_2, synchbuckets_2, synchbuckets2_2, synchbuckets3_2
panel_7 = Panel(keysearch_2)
explode = Explode(Curve=bucketsimitems.synchbuckets2_2, Recursive=True)  # -> Segments, Vertices
panel_8 = Panel(bucketsimitems.buckets_2)
item = ListItem(List=explode.Vertices, Index=0, Wrap=True)
pdecon = Deconstruct(Point=item)  # -> XComponent, YComponent, ZComponent
shift = ShiftPaths(Data=pdecon.ZComponent, Offset=-1)
sort = SortList(Keys=shift, ValuesA=bucketsimitems.synchbuckets2_2)  # -> Keys, ValuesA
branch = TreeBranch(Tree=sort.ValuesA, Path=Slider(0, range=0..1), MaintainPaths=True)
project = Project(Geometry=sort.ValuesA, Plane=PlaneXY(0, 0, 0))  # -> Geometry, Transform
crossref = CrossReference(ListA=project.Geometry, ListB=project.Geometry, CrossMode=1)  # -> ListA, ListB
ccx = CurveCurve(CurveA=crossref.ListA, CurveB=crossref.ListB)  # -> Points, ParamsA, ParamsB
panel_9 = Panel(sort.ValuesA)

# ==== cluster BucketSimItems
synchronous2 = ClusterInput()
flatlist = ClusterInput()
synchronous3 = ClusterInput()
synchronous = ClusterInput()
flatlist_2 = Data(flatten(flatlist))
synchronous2_2 = Data(flatten(synchronous2))
synchronous3_2 = Data(flatten(synchronous3))
synchronous_2 = Data(flatten(synchronous))
data = Data(simplify(graft(synchronous2_2)))
data_2 = Data(simplify(graft(synchronous3_2)))
data_3 = Data(simplify(graft(flatlist_2)))
data_4 = Data(simplify(graft(synchronous_2)))
cset = CreateSet(List=flatlist_2)  # -> Set, Map
mindex = MemberIndex(Set=cset.Set, Member=flatlist_2)  # -> flatten(Index), Count
viewer = ParamViewer(data_3)
replace = ReplacePaths(Data=data_3, Search=viewer, Replace=mindex.Index)
replace_2 = ReplacePaths(Data=data, Search=viewer, Replace=mindex.Index)
replace_3 = ReplacePaths(Data=data_2, Search=viewer, Replace=mindex.Index)
replace_4 = ReplacePaths(Data=data_4, Search=viewer, Replace=mindex.Index)
buckets = Data(replace)
synchbuckets2 = Data(replace_2)
synchbuckets3 = Data(replace_3)
synchbuckets = Data(replace_4)
buckets_2 = ClusterOutput(buckets)
synchbuckets2_2 = ClusterOutput(synchbuckets2)
synchbuckets3_2 = ClusterOutput(synchbuckets3)
synchbuckets_2 = ClusterOutput(synchbuckets)

# ==== cluster TowerByCurves
geo = ClusterInput()
geo_2 = Geometry(geo)
clockcrv = ClockwiseCurve(crv=geo_2)
data = Data(clockcrv)
objatts = ObjectAttributes(ObjectOrAttributes=data)  # -> Name, LayerName, LayerFullPath, Color, MaterialName, LinetypeName, GroupIndices, PlotWeight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
panel = Panel("""BuildID
Typology
F2F
Levels
SubBuildID""")
json = JSON(Key=objatts.UserDataKeys, Value=objatts.UserDataValues)
read = ReadJSON(Object=json, Key=panel)
flip = FlipMatrix(Data=read)
read_2 = ReadJSON(Object=json, Key="Typology")  # -> flatten(Value)
read_3 = ReadJSON(Object=json, Key="SubBuildID")  # -> flatten(Value)
read_4 = ReadJSON(Object=json, Key="BuildID")  # -> flatten(Value)
branch = TreeBranch(Tree=simplify(flip), Path="3", MaintainPaths=True)  # -> graft(Branch)
branch_2 = TreeBranch(Tree=simplify(flip), Path="2", MaintainPaths=True)  # -> graft(Branch)
branch_3 = TreeBranch(Tree=flip, Path="0", MaintainPaths=True)
branch_4 = TreeBranch(Tree=flip, Path="4", MaintainPaths=True)
cset = CreateSet(List=flatten(read_4))  # -> Set, Map
addition = Addition(A=branch, B=1)
concat = Concatenate(FragmentA=branch_3, FragmentB=branch_4)
series = Series(Start=0, Step=branch_2, Count=addition)  # -> simplify(Series)
mindex = MemberIndex(Set=flatten(read_4), Member=cset.Set)  # -> Index, Count
panel_2 = Panel(concat)
python = GhPythonScript(ID=concat)  # -> StackID
# ---------- python: Python ----------
__author__ = "B-MBuckley"
__version__ = "2018.10.25"

import rhinoscriptsyntax as rs

StackID = []

for i in range(len(ID)-1):
    StackID.append(ID[0:i+1])
# ---------- end python ----------
item = ListItem(List=series, Index=0, Wrap=True)  # -> flatten(Item1), Item
item_2 = ListItem(List=read_2, Index=mindex.Index, Wrap=True)  # -> simplify(Item)
item_3 = ListItem(List=read_3, Index=mindex.Index, Wrap=True)
item_4 = ListItem(List=read_4, Index=mindex.Index, Wrap=True)
mindex_2 = MemberIndex(Set=panel_2, Member=python)  # -> Index, Count
panel_3 = Panel(item.Item1)
tsort = SortText(Keys=item_3, Values=item_2, Culture=127)  # -> Keys, Values
tsort_2 = SortText(Keys=item_3, Values=item_4, Culture=127)  # -> Keys, Values
item_5 = ListItem(List=panel_3, Index=mindex_2.Index, Wrap=True)
trim = TrimTree(Tree=item_5, Depth=1)
cset_2 = CreateSet(List=tsort_2.Values)  # -> Set, Map
graft = GraftTree(Tree=tsort.Values, IncludeEmptyLists=True, IncludeNullItems=True)
graft_2 = GraftTree(Tree=tsort_2.Keys, IncludeEmptyLists=True, IncludeNullItems=True)
graft_3 = GraftTree(Tree=tsort_2.Values, IncludeEmptyLists=True, IncludeNullItems=True)
ma = MassAddition(Input=trim)  # -> Result, PartialResults
nullrep = ReplaceNulls(Items=ma.Result, Replacements="0")  # -> Items, Count
addition_2 = Addition(A=nullrep.Items, B=series)
data_2 = Data(addition_2)
pt = ConstructPoint(XCoordinate=0, YCoordinate=0, ZCoordinate=data_2)
xy = XYPlane(Origin=pt)
project = Project(Geometry=graft(data), Plane=xy)  # -> simplify(Geometry), Transform
projected_floor_curves = Geometry(project.Geometry)
first_last = FirstLast(List=projected_floor_curves)  # -> FirstValue, LastValue
first_last_2 = FirstLast(List=projected_floor_curves)  # -> FirstValue, LastValue
facade = Loft(
    Curves=[first_last.FirstValue, first_last_2.LastValue],
    Options={Adjust=False, Closed=False, LoftEnds=0, LoftSimp=0, LoftType=0, Rebuild=10, Refit=0.01})  # -> simplify(Loft)
geo_3 = Geometry(flatten(facade))
cap = CapHoles(Brep=geo_3)
item_6 = ListItem(List=cap, Index=mindex.Index, Wrap=True)
item_7 = ListItem(List=geo_3, Index=mindex.Index, Wrap=True)
tsort_3 = SortText(Keys=item_3, Values=item_6, Culture=127)  # -> Keys, Values
tsort_4 = SortText(Keys=item_3, Values=item_7, Culture=127)  # -> Keys, Values
graft_4 = GraftTree(Tree=tsort_3.Values, IncludeEmptyLists=True, IncludeNullItems=True)  # -> simplify(SubMass)
graft_5 = GraftTree(Tree=tsort_4.Values, IncludeEmptyLists=True, IncludeNullItems=True)
debrep = DeconstructBrep(Brep=graft_5)  # -> simplify(Faces), Edges, Vertices
boundary = BoundarySurfaces(Edges=project.Geometry)
floor_surfaces = Geometry(boundary)
cull_i = CullIndex(List=floor_surfaces, Indices=-1, Wrap=True)
group = Group(Objects=cull_i)  # -> flatten(Group)
item_8 = ListItem(List=group, Index=mindex.Index, Wrap=True)
tsort_5 = SortText(Keys=item_3, Values=item_8, Culture=127)  # -> Keys, Values
ungroup = Ungroup(Group=tsort_5.Values)  # -> simplify(Objects)
lng = ListLength(List=ungroup)
geo_4 = Geometry(ungroup)
dup = DuplicateData(Data=graft, Number=lng, Order=True)  # -> simplify(Data)
dup_2 = DuplicateData(Data=graft_2, Number=lng, Order=True)  # -> simplify(Data)
dup_3 = DuplicateData(Data=graft_3, Number=lng, Order=True)  # -> simplify(Data)
area = Area(Geometry=geo_4)  # -> Area, Centroid
xy_2 = XYPlane(Origin=area.Centroid)
pdecon = Deconstruct(Point=area.Centroid)  # -> XComponent, YComponent, simplify(ZComponent)
group_2 = Group(Objects=xy_2)
long = LongestList(ListA=debrep.Faces, ListB=group_2, PaddingMode=2)  # -> graft(ListA), ListB
ungroup_2 = Ungroup(Group=long.ListB)
sec = BrepPlane(Brep=long.ListA, Plane=ungroup_2)  # -> Curves, Points
shift = ShiftPaths(Data=sec.Curves, Offset=-1)
srfsplit = SurfaceSplit(Surface=long.ListA, Curves=shift)
first_last_3 = FirstLast(List=boundary)  # -> FirstValue, LastValue
trim_2 = TrimTree(Tree=srfsplit, Depth=1)
trim_3 = TrimTree(Tree=trim_2, Depth=1)
rint = RegionIntersection(CurvesA=flatten(first_last_3.FirstValue), CurvesB=first_last_3.LastValue)
area_2 = Area(Geometry=trim_3)  # -> Area, Centroid
boundary_2 = BoundarySurfaces(Edges=rint)
pdecon_2 = Deconstruct(Point=area_2.Centroid)  # -> XComponent, YComponent, ZComponent
panel_4 = Panel("""RL
Typology
SubBuildID
BuildID""")
panel_5 = Panel("""Typology
SubBuildID
BuildID""")
panel_6 = Panel("""Typology
SubBuildID
BuildID""")
merge = Merge(Data1=simplify(graft(tsort.Values)), Data2=simplify(graft(tsort_2.Keys)), Data3=simplify(graft(tsort_2.Values)))  # -> simplify(Result)
merge_2 = Merge(Data1=simplify(graft(cset_2.Set)))  # -> simplify(Result)
merge_3 = Merge(Data1=simplify(graft(graft)), Data2=simplify(graft(graft_2)), Data3=simplify(graft(graft_3)))  # -> simplify(Result)
merge_4 = Merge(Data1=simplify(graft(dup)), Data2=simplify(graft(dup_2)), Data3=simplify(graft(dup_3)))  # -> simplify(Result)
merge_5 = Merge(
    Data1=simplify(graft(pdecon.ZComponent)),
    Data2=simplify(graft(dup)),
    Data3=simplify(graft(dup_2)),
    Data4=simplify(graft(dup_3)))  # -> simplify(Result)
panel_7 = Panel("""Typology
SubBuildID
BuildID""")
sdiff = SolidDifference(BrepsA=first_last_3.LastValue, BrepsB=flatten(boundary_2))
trim_4 = TrimTree(Tree=graft_5, Depth=1)
sort = SortList(Keys=pdecon_2.ZComponent, ValuesA=trim_3)  # -> Keys, ValuesA
lng_2 = ListLength(List=debrep.Faces)
group_3 = Group(Objects=sdiff)
partition = PartitionList(List=sort.ValuesA, Size=lng_2)
json_2 = JSON(Key=panel_5, Value=merge_4)
json_3 = JSON(Key=panel_4, Value=merge_5)
item_9 = ListItem(List=flatten(group_3), Index=mindex.Index, Wrap=True)
join = BrepJoin(Breps=partition)  # -> simplify(Breps), Closed
trim_5 = TrimTree(Tree=json_3, Depth=1)
json_4 = JSON(Key=panel_6, Value=merge)
cap_2 = CapHoles(Brep=trim_4)
geo_5 = Geometry(geo_4)
tsort_6 = SortText(Keys=item_3, Values=item_9, Culture=127)  # -> Keys, simplify(Values)
trim_6 = TrimTree(Tree=json_4, Depth=1)
sunion = SolidUnion(Breps=cap_2)
trim_7 = TrimTree(Tree=join.Breps, Depth=2)
trim_8 = TrimTree(Tree=json_2, Depth=2)
trim_9 = TrimTree(Tree=geo_5, Depth=1)
trim_10 = TrimTree(Tree=trim_5, Depth=1)
json_5 = JSON(Key="BuildID", Value=merge_2)
json_6 = JSON(Key=panel_7, Value=merge_3)
sub_mass_properties = Data(json_6)
floorplate_properties = Data(trim_10)
full_mass_properties = Data(json_5)
facade_properties = Data(trim_8)
full_mass = Data(simplify(graft(sunion)))
roof_properties = Data(trim_6)
floorplates = Data(trim_9)
sub_mass = Geometry(graft_4)
roof = Data(tsort_6.Values)
facade_2 = Data(trim_7)
roof_2 = ClusterOutput(roof)
roof_properties_2 = ClusterOutput(roof_properties)
full_mass_2 = ClusterOutput(full_mass)
full_mass_properties_2 = ClusterOutput(full_mass_properties)
sub_mass_2 = ClusterOutput(sub_mass)
sub_mass_properties_2 = ClusterOutput(sub_mass_properties)
facade_3 = ClusterOutput(facade_2)
facade_properties_2 = ClusterOutput(facade_properties)
floorplates_2 = ClusterOutput(floorplates)
floorplate_properties_2 = ClusterOutput(floorplate_properties)

# ==== cluster ClockwiseCurve: Reorders controlpoints of curve to clockwise
crv = ClusterInput()
crv_2 = Curve(crv)
cp = ControlPoints(Curve=crv_2)  # -> simplify(Points), Weights, Knots
shift = ShiftList(List=cp.Points, Shift=1, Wrap=True)
pdecon = Deconstruct(Point=cp.Points)  # -> XComponent, YComponent, ZComponent
pdecon_2 = Deconstruct(Point=shift)  # -> XComponent, YComponent, ZComponent
expression = Expression(x=pdecon.XComponent, y=pdecon_2.XComponent, z=pdecon.YComponent, u=pdecon_2.YComponent, Expression="(y-x)*(u+z)")
ma = MassAddition(Input=expression)  # -> Result, PartialResults
larger = LargerThan(FirstNumber=ma.Result, SecondNumber=0)  # -> simplify(LargerThan), OrEqualTo
dispatch = Dispatch(List=simplify(graft(crv_2)), DispatchPattern=larger.LargerThan)  # -> ListA, ListB
flip = FlipCurve(Curve=dispatch.ListB)  # -> Curve, Flag
merge = Merge(Data1=dispatch.ListA, Data2=flip.Curve)  # -> simplify(flatten(Result))
unflatten = UnflattenTree(Tree=merge, Guide=crv_2)
crv_3 = Curve(unflatten)
crv_4 = ClusterOutput(crv_3)
