# Grasshopper definition Curve method.ghx (Grasshopper 1.0.7)
# plug-ins: treesloth01, Human, Bifocals

panel = Panel("""Curve
Curve
Curve
Curve""")
input = DataInput(Destination="C:\Users\b-mbuckley\Documents\Hackathon2018\Curve Method.ghdata")  # -> E, D, Facades, A, B
dpipeline = DynamicGeometryPipeline(
    LayerFilter="Layer 01::Input Curves",
    TypeFilter="Curve",
    NameFilter="*",
    GroupByLayer=False,
    GroupByType=False,
    IncludeHidden=True,
    IncludeLocked=True,
    enableFullPath=True,
    listenToAttributes=True)
panel_2 = Panel("""Y
Y
X
X""")
cluster = Cluster(curves=dpipeline)  # -> roof_2, floors_2, facade_2, mass, json_4
panel_3 = Panel("""Resi
Comm
Resi
Resi""")
panel_4 = Panel("""3
3
3
3""")
panel_5 = Panel("""3
15
23
19""")
output = DataOutput(
    Roofs=cluster.roof_2,
    Floors=cluster.floors_2,
    Facades=cluster.facade_2,
    Mass=cluster.mass,
    Json=cluster.json_4,
    Destination="C:\Users\b-mbuckley\Documents\Hackathon2018\Curve Method.ghdata")
panel_6 = Panel("""A
A
A
A""")
entwine = Entwine(Branch00=panel_2, Branch01=panel_3, Branch02=panel_4, Branch03=panel_5, Branch04=panel_6, FlattenInputs=True)  # -> simplify(Result)

keysearch = KeyValueSearch(Search="BuildID")
keysearch_2 = KeyValueSearch(Search="SubBuildID")
bucketsimitems = BucketSimItems(flatlist=flatten(keysearch), synchronous=flatten(keysearch_2))  # -> buckets_2, synchbuckets_2, synchbuckets2_2, synchbuckets3_2
panel_7 = Panel(keysearch_2)
explode = Explode(Curve=bucketsimitems.synchbuckets2_2, Recursive=True)  # -> Segments, Vertices
panel_8 = Panel(bucketsimitems.buckets_2)
item = ListItem(List=explode.Vertices, Index=0, Wrap=True)
pdecon = Deconstruct(Point=item)  # -> XComponent, YComponent, ZComponent
shift = ShiftPaths(Data=pdecon.ZComponent, Offset=-1)
sort = SortList(Keys=shift, ValuesA=bucketsimitems.synchbuckets2_2)  # -> Keys, ValuesA
branch = TreeBranch(Tree=sort.ValuesA, Path=Slider(0, range=0..1), MaintainPaths=True)
project = Project(Geometry=sort.ValuesA, Plane=PlaneXY(0, 0, 0))  # -> Geometry, Transform
crossref = CrossReference(ListA=project.Geometry, ListB=project.Geometry, CrossMode=1)  # -> ListA, ListB
ccx = CurveCurve(CurveA=crossref.ListA, CurveB=crossref.ListB)  # -> Points, ParamsA, ParamsB
panel_9 = Panel(sort.ValuesA)

# ==== cluster BucketSimItems
synchronous2 = ClusterInput()
flatlist = ClusterInput()
synchronous3 = ClusterInput()
synchronous = ClusterInput()
flatlist_2 = Data(flatten(flatlist))
synchronous2_2 = Data(flatten(synchronous2))
synchronous3_2 = Data(flatten(synchronous3))
synchronous_2 = Data(flatten(synchronous))
data = Data(simplify(graft(synchronous2_2)))
data_2 = Data(simplify(graft(synchronous3_2)))
data_3 = Data(simplify(graft(flatlist_2)))
data_4 = Data(simplify(graft(synchronous_2)))
cset = CreateSet(List=flatlist_2)  # -> Set, Map
mindex = MemberIndex(Set=cset.Set, Member=flatlist_2)  # -> flatten(Index), Count
viewer = ParamViewer(data_3)
replace = ReplacePaths(Data=data_3, Search=viewer, Replace=mindex.Index)
replace_2 = ReplacePaths(Data=data, Search=viewer, Replace=mindex.Index)
replace_3 = ReplacePaths(Data=data_2, Search=viewer, Replace=mindex.Index)
replace_4 = ReplacePaths(Data=data_4, Search=viewer, Replace=mindex.Index)
buckets = Data(replace)
synchbuckets2 = Data(replace_2)
synchbuckets3 = Data(replace_3)
synchbuckets = Data(replace_4)
buckets_2 = ClusterOutput(buckets)
synchbuckets2_2 = ClusterOutput(synchbuckets2)
synchbuckets3_2 = ClusterOutput(synchbuckets3)
synchbuckets_2 = ClusterOutput(synchbuckets)

# ==== cluster Cluster
curves = ClusterInput()
clockcrv = ClockwiseCurve(crv=curves)
data = Data(clockcrv)
objatts = ObjectAttributes(ObjectOrAttributes=data)  # -> Name, LayerName, LayerFullPath, Color, MaterialName, LinetypeName, GroupIndices, PlotWeight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
panel = Panel("""BuildID
Typology
F2F
Levels
SubBuildID""")
json = JSON(Key=objatts.UserDataKeys, Value=objatts.UserDataValues)
read = ReadJSON(Object=json, Key=panel)
json_2 = JSON(Key=objatts.UserDataKeys, Value=objatts.UserDataValues)
flip = FlipMatrix(Data=read)
panel_2 = Panel(read)
branch = TreeBranch(Tree=simplify(flip), Path="3", MaintainPaths=True)  # -> graft(Branch)
branch_2 = TreeBranch(Tree=simplify(flip), Path="2", MaintainPaths=True)  # -> graft(Branch)
branch_3 = TreeBranch(Tree=flip, Path="0", MaintainPaths=True)
branch_4 = TreeBranch(Tree=flip, Path="4", MaintainPaths=True)
addition = Addition(A=branch, B=1)
concat = Concatenate(FragmentA=branch_3, FragmentB=branch_4)
series = Series(Start=0, Step=branch_2, Count=addition)  # -> simplify(Series)
panel_3 = Panel(concat)
python = GhPythonScript(ID=concat)  # -> StackID
# ---------- python: Python ----------
__author__ = "B-MBuckley"
__version__ = "2018.10.25"

import rhinoscriptsyntax as rs

StackID = []

for i in range(len(ID)-1):
    StackID.append(ID[0:i+1])
# ---------- end python ----------
item = ListItem(List=series, Index=0, Wrap=True)  # -> flatten(Item1), Item
mindex = MemberIndex(Set=panel_3, Member=python)  # -> Index, Count
panel_4 = Panel(item.Item1)
item_2 = ListItem(List=panel_4, Index=mindex.Index, Wrap=True)
trim = TrimTree(Tree=item_2, Depth=1)
ma = MassAddition(Input=trim)  # -> Result, PartialResults
nullrep = ReplaceNulls(Items=ma.Result, Replacements="0")  # -> Items, Count
addition_2 = Addition(A=nullrep.Items, B=series)
data_2 = Data(addition_2)
pt = ConstructPoint(XCoordinate=0, YCoordinate=0, ZCoordinate=data_2)
xy = XYPlane(Origin=pt)
project = Project(Geometry=graft(data), Plane=xy)  # -> Geometry, Transform
boundary = BoundarySurfaces(Edges=project.Geometry)
first_last = FirstLast(List=project.Geometry)  # -> FirstValue, LastValue
first_last_2 = FirstLast(List=project.Geometry)  # -> FirstValue, LastValue
first_last_3 = FirstLast(List=boundary)  # -> FirstValue, LastValue
first_last_4 = FirstLast(List=boundary)  # -> FirstValue, LastValue
index = ItemIndex(List=boundary, Item=first_last_4.LastValue)
facade = Loft(
    Curves=[first_last.FirstValue, first_last_2.LastValue],
    Options={Adjust=False, Closed=False, LoftEnds=0, LoftSimp=0, LoftType=0, Rebuild=10, Refit=0.01})  # -> simplify(Loft)
json_3 = Data(json)
roof = Surface(simplify(first_last_3.LastValue))

floors = CullIndex(List=boundary, Indices=index, Wrap=True)  # -> simplify(List)

full_mass = CapHoles(Brep=facade)  # -> simplify(Brep)

# ---- group: List
facade_2 = ClusterOutput(facade)

# ---- group: Surface
floors_2 = ClusterOutput(floors)

# ---- group: Loft
mass = ClusterOutput(full_mass)

# ---- group: Mass
json_4 = ClusterOutput(json_3)

# ---- group: Cluster Output
roof_2 = ClusterOutput(roof)

# ==== cluster ClockwiseCurve: Reorders controlpoints of curve to clockwise
crv = ClusterInput()
crv_2 = Curve(crv)
cp = ControlPoints(Curve=crv_2)  # -> simplify(Points), Weights, Knots
shift = ShiftList(List=cp.Points, Shift=1, Wrap=True)
pdecon = Deconstruct(Point=cp.Points)  # -> XComponent, YComponent, ZComponent
pdecon_2 = Deconstruct(Point=shift)  # -> XComponent, YComponent, ZComponent
expression = Expression(x=pdecon.XComponent, y=pdecon_2.XComponent, z=pdecon.YComponent, u=pdecon_2.YComponent, Expression="(y-x)*(u+z)")
ma = MassAddition(Input=expression)  # -> Result, PartialResults
larger = LargerThan(FirstNumber=ma.Result, SecondNumber=0)  # -> simplify(LargerThan), OrEqualTo
dispatch = Dispatch(List=simplify(graft(crv_2)), DispatchPattern=larger.LargerThan)  # -> ListA, ListB
flip = FlipCurve(Curve=dispatch.ListB)  # -> Curve, Flag
merge = Merge(Data1=dispatch.ListA, Data2=flip.Curve)  # -> simplify(flatten(Result))
unflatten = UnflattenTree(Tree=merge, Guide=crv_2)
crv_3 = Curve(unflatten)
crv_4 = ClusterOutput(crv_3)
